# Dynamo graph Fribrocimento ondulada.dyn (Dynamo 1.3.4.6666)

select_model_element = DSModelElementSelection()
family_types = FamilyTypes("Telha_Fibrocimento_3pontos:Telha_Fibrocimento_3pontos")
family_types_2 = FamilyTypes("Telha_Fibrocimento_4pontos:Telha_Fibrocimento_4pontos")
family_types_3 = FamilyTypes("Telha_Fibrocimento_5pontos:Telha_Fibrocimento_5pontos")
family_types_4 = FamilyTypes("Telha_Fibrocimento_5pontos:Telha_Fibrocimento_5pontos")
family_types_5 = FamilyTypes("Telha_Fibrocimento_6pontos:Telha_Fibrocimento_6pontos")
family_types_6 = FamilyTypes("Telha_Fibrocimento_7pontos:Telha_Fibrocimento_7pontos")
family_types_7 = FamilyTypes("Telha_Fibrocimento_8pontos:Telha_Fibrocimento_8pontos")
create = List.Create(family_types, family_types_2, family_types_3, family_types_4, family_types_5, family_types_6, family_types_7)
family_types_8 = FamilyTypes("Rufo_com_aba:Rufo_com_aba")
createRoof = RoofGenerator.RoofGenerator.CreateRoof(select_model_element, create, family_types_8)
watch = Watch(createRoof)
