# Dynamo graph Telha Romana.dyn (Dynamo 1.3.4.6666)

select_model_element = DSModelElementSelection()  # 1 picked in the model
family_types = FamilyTypes("Telha_Romana_3pontos:Telha_Romana_3pontos")
family_types_2 = FamilyTypes("Telha_Romana_4pontos:Telha_Romana_4pontos")
family_types_3 = FamilyTypes("Telha_Romana_4pontos:Telha_Romana_4pontos")
family_types_4 = FamilyTypes("Telha_Romana_5pontos:Telha_Romana_5pontos")
family_types_5 = FamilyTypes("Telha_Romana_6pontos:Telha_Romana_6pontos")
family_types_6 = FamilyTypes("Telha_Romana_7pontos:Telha_Romana_7pontos")
family_types_7 = FamilyTypes("Telha_Romana_8pontos:Telha_Romana_8pontos")
create = List.Create(family_types, family_types_2, family_types_3, family_types_4, family_types_5, family_types_6, family_types_7)
family_types_8 = FamilyTypes("Telha_Romana_2pontos:Padrão")
createRoof = RoofGenerator.RoofGenerator.CreateRoof(select_model_element, create, family_types_8)
watch = Watch(createRoof)
